% Simulink data dictionary data_params.sldd

Sig = Simulink.Signal()

IC = struct(
  temp_core=293,
  temp_chassis=293,
  temp_rad=220,
  temp_PCM=293,
  power_motor=0.5,
  temp_MLI_front=220,
  temp_MLI_back=220,
  temp_MLI_top=220,
  temp_MLI_bottom=220,
  temp_MLI_right=220,
  temp_MLI_left=220)

p = struct(temp_load_shedding_on=328)
Constant = struct(sigma=5.67e-8)
Area = struct(front=0.08, back=0.08, top=0.1, bottom=0.2, left=0.1, right=0.1, rad=0.1, solar_panel=0.1)

Cond = struct(
  area_core_chassis=0.04,
  thick_core_chassis=0.005,
  k_core_chassis=5,
  area_core_PCM=0.2,
  thick_core_PCM=0.005,
  k_core_PCM=10,
  area_PCM_rad=0.2,
  thick_PCM_rad=0.0075,
  k_PCM_rad=5)

Spec = struct(
  alpha_rad=0.09,
  epsilon_rad=0.91,
  mass_rad_kg=0.1,
  cp_rad_J_kgK=896,
  mass_chassis_kg=7,
  cp_chassis_J_kgK=896,
  mass_electronics_kg=5,
  cp_electronics_J_kgK=1000,
  alpha_mli=0.35,
  epsilon_mli=0.85,
  epsilon_eff_leak_mli=0.03,
  mass_mli=0.9,
  cp_mli_J_kgK=1000,
  mass_PCM=0.7,
  cp_PCM_J_kgK=2000,
  mass_cover=2.7,
  cp_cover=896,
  epsilon_back_cover=0.91,
  epsilon_front_cover=0.85,
  alpha_front_cover=0.91,
  solar_eff=0.3)

P = struct(
  driving_speed=0.75,
  mass_rover=15,
  temp_load_shedding_off=300,
  temp_load_shedding_on=302,
  power_avionics=20,
  gamma_start_sun=45,
  z_start_sun=89.5)